# Grasshopper definition simple_simulation_shoebox.ghx (Grasshopper 1.0.8)
# plug-ins: COMPAS Acoustics

# ---- group: 1 Room: a 5 x 4 x 3 m box, its six walls as meshes
corner_a = Panel("0,0,0")
corner_b = Panel("5,4,3")
box = Box2Pt(PointA=corner_a, PointB=corner_b, Plane=PlaneXY(0, 0, 0))
debrep = DeconstructBrep(Brep=box)  # -> Faces, Edges, Vertices
order = Panel("""4
0
1
2
3
5""")
item = ListItem(List=debrep.Faces, Index=order, Wrap=True)
mesh = MeshBrep(
    Brep=item,
    Settings={GridMaxCount=0, GridMinCount=16, JaggedSeams=False, MaxEdgeLength=0, MinEdgeLength=0.0001, MinTolerance=0, Refine=True, RefineAngle=0, RelativeTolerance=0.65, SimplePlanes=True, Tolerance=0})

# ---- group: 2 Materials: absorption and scattering in 7 octave bands
absorption = Panel("""0.01
0.01
0.02
0.02
0.02
0.05
0.05""")
name = Panel("concrete")
absorption_2 = Panel("""0.01
0.02
0.02
0.03
0.03
0.04
0.04""")
name_2 = Panel("brickwall")
absorption_3 = Panel("""0.07
0.31
0.49
0.81
0.66
0.54
0.48""")
name_3 = Panel("carpet")
absorption_4 = Panel("""0.17
0.36
0.66
0.65
0.62
0.68
0.80""")
name_4 = Panel("acoustic_plaster")
scattering = Panel("""0.01
0.01
0.03
0.05
0.1
0.1
0.1""")
scattering_2 = Panel("""0.01
0.01
0.03
0.05
0.2
0.25
0.3""")
scattering_3 = Panel("0.2")
scattering_4 = Panel("0.2")
concrete = ConstructMaterial(
    Absorption=absorption,
    Scattering=scattering,
    Name=name,
    control_inputs_hidden="category",
    control_inputs_shown=False,
    preview_default_v2=True)
brickwall = ConstructMaterial(
    Absorption=absorption_2,
    Scattering=scattering_2,
    Name=name_2,
    control_inputs_hidden="category",
    control_inputs_shown=False,
    preview_default_v2=True)
carpet = ConstructMaterial(
    Absorption=absorption_3,
    Scattering=scattering_3,
    Name=name_3,
    control_inputs_hidden="category",
    control_inputs_shown=False,
    preview_default_v2=True)
acoustic_plaster = ConstructMaterial(
    Absorption=absorption_4,
    Scattering=scattering_4,
    Name=name_4,
    control_inputs_hidden="category",
    control_inputs_shown=False,
    preview_default_v2=True)
merge = Merge(Data1=carpet, Data2=acoustic_plaster, Data3=acoustic_plaster, Data4=brickwall, Data5=brickwall, Data6=concrete)

# ---- group: 3 Acoustic objects: one per wall
surfaces = Panel("""floor
right_wall
front_wall
left_wall
back_wall
ceiling""")
obj = AcousticObject(Geometry=mesh, Material=merge, Name=surfaces, preview_default_v2=True)

# ---- group: 4 Sources and receivers
position = Panel("4,3,1.5")
name_5 = Panel("source_1")
position_2 = Panel("3,2,1.5")
name_6 = Panel("source_2")
position_3 = Panel("2,2,1.6")
name_7 = Panel("receiver_1")
position_4 = Panel("1,1,1.1")
name_8 = Panel("receiver_2")
source = Source(Position=position, Name=name_5, control_inputs_hidden="sound_file", control_inputs_shown=False, preview_default_v2=True)
source_2 = Source(
    Position=position_2,
    Name=name_6,
    control_inputs_hidden="sound_file",
    control_inputs_shown=False,
    preview_default_v2=True)
receiver = Receiver(Position=position_3, Name=name_7, preview_default_v2=True)
receiver_2 = Receiver(Position=position_4, Name=name_8, preview_default_v2=True)

# ---- group: 5 Scene and simulation
name_9 = Panel("Demo Scene")
scene = AcousticScene(
    Objects=flatten(obj),
    Sources=flatten([source, source_2]),
    Receivers=flatten([receiver, receiver_2]),
    Name=name_9,
    preview_default_v2=True)
n_rays = Panel("10000")
seed = Panel("42")
simmono = SimulateMono(
    Scene=scene,
    N_rays=n_rays,
    Energy_thres=1e-07,
    Seed=seed,
    control_inputs_hidden="""ism_order
ray_tracing
absorb_air
normalize""",
    control_inputs_shown=False,
    control_value_ism_order="3",
    preview_default_v2=True)

# ---- group: 6 Analysis: source_2 to receiver_2, T30
deirgraph = DeconstructIRGraph(
    Ir_graph=simmono,
    control_inputs_hidden="""source_idx
receiver_idx""",
    control_inputs_shown=False,
    control_value_receiver_idx="1",
    control_value_source_idx="1",
    preview_default_v2=True)  # -> Ir, Sources, Receivers, Edges
analyseir = AnalyseImpulseResponse(Ir=deirgraph.Ir, preview_default_v2=True)  # -> Parameters, Time, Frequency
deparam = DeconstructParameter(Parameters=analyseir.Parameters, choice_select="T30", preview_default_v2=True)  # -> Parameter, Name, Values, Overall, Frequencies
plot2d = Plot2D(Data=deparam.Parameter, chart_height=200, chart_width=360, preview_default_v2=True)
